% Simulink data dictionary ACAL_Dictionary.sldd
% references DU_ApplicationLayerDictionary.sldd
% references DU_DeviceLayerDictionary.sldd
% references DU_MotorControlDictionary.sldd

ACAL_InstallationAngle = Ebikepkg_ACAL.Signal(StorageClass="ImportFromFile", HeaderFile="Commons.h", DataType="typ_angle_mrad_t")
ACAL_MountingOrientationPlausibilityEnable = Ebikepkg_ACAL.Signal(StorageClass="ImportFromFile", HeaderFile="Commons.h", DataType="bool_t")
AccBasedBikeSpeed = Ebikepkg_ACAL.Signal(StorageClass="ACAL_Prefix", DataType="typ_speed_10m_h_t")
AccDrivingDirection = Ebikepkg_ACAL.Signal(StorageClass="ACAL_Prefix", DataType="typ_acceleration_10mm_ss_t")
AccOrthogonalDrivingDirection = Ebikepkg_ACAL.Signal(StorageClass="ACAL_Prefix", DataType="typ_acceleration_10mm_ss_t", Min=0)
P_Kalman1_init = [0.0001 0.0001; 0.0001 0.1236]
P_Kalman2_init = [10000 100000 -20000; 100000 600000 -100000; -20000 -100000 50000]
TargetStandardDeviationForRefAcc = Ebikepkg_ACAL.Parameter(0.13, StorageClass="EbikePack", HeaderFile="MovementDetection.h", DataType="typ_acceleration_10mm_ss_t")
InstallationAngle = Ebikepkg_ACAL.Signal(StorageClass="ACAL_Prefix", DataType="typ_angle_mrad_t")
ConfidenceLevelSlope = Ebikepkg_ACAL.Signal(StorageClass="ACAL_Prefix", DataType="typ_ratio_10m_t")
DriverTorqueAccelerationCovariance = Ebikepkg_ACAL.Signal(StorageClass="ACAL_Prefix", DataType="typ_ratio_10m_t")
StandardDeviationAcc = Ebikepkg_ACAL.Signal(StorageClass="ACAL_Prefix", DataType="typ_acceleration_10mm_ss_t")
ReedPulse = Ebikepkg_ACAL.Signal(StorageClass="GetSet", HeaderFile="AccelerationCalc.h", GetFunction="ACAL_getReedPulseStatus", SetFunction="none20", DataType="bool_t")
ACAL_InstallationAngleCorrected = Ebikepkg_ACAL.Signal(StorageClass="ImportFromFile", HeaderFile="Commons.h", DataType="boolean")
AccSensorOutOfRangePrefailed = Ebikepkg_ACAL.Signal(StorageClass="GetSet", HeaderFile="ErrorManagerAdapter.h", GetFunction="ERRMA_reportFaultPrefailedNONE", SetFunction="ERRMA_reportFaultPrefailed", DataType="Enum: faults_t", Units="auto")
AccSensorOutOfRangePrepassed = Ebikepkg_ACAL.Signal(StorageClass="GetSet", HeaderFile="ErrorManagerAdapter.h", GetFunction="ERRMA_reportFaultPrepassedNONE", SetFunction="ERRMA_reportFaultPrepassed", DataType="Enum: faults_t", Units="auto")
DRIVE_UNIT_BASE_SW = Simulink.Parameter(1, StorageClass="Define", HeaderFile="GlobalDriveUnit_Config.h", DataType="uint8", Units="auto")
ACAL_CODE_FOR_EB_SW = Simulink.Variant(Condition="DRIVE_UNIT_BASE_SW == 1")
ACAL_CODE_FOR_NE5_SW = Simulink.Variant(Condition="DRIVE_UNIT_BASE_SW == 0")
StandardDeviationAccOrthogonal = Ebikepkg_ACAL.Signal(StorageClass="ACAL_Prefix", DataType="typ_acceleration_10mm_ss_t", Units="auto")
PTCO_setAccelerationCalcTorqueReductionFactor = Simulink.Signal(StorageClass="GetSet", HeaderFile="PowerTorqueCoordinator.h", GetFunction="$N_none", SetFunction="$N", DataType="typ_ratio_10m_t", Units="auto")
ACAL_BikeUpsideDown = Ebikepkg_ACAL.Signal(StorageClass="ImportFromFile", HeaderFile="Commons.h", DataType="bool_t", Units="auto")
ACAL_PresentSlope = Simulink.Signal(StorageClass="ImportFromFile", HeaderFile="AccelerationCalc.h", DataType="typ_ratio_10m_t")
MOVD_getStateOfMotion = Ebikepkg_ACAL.Signal(StorageClass="GetSet", HeaderFile="MovementDetection.h", GetFunction="MOVD_getStateOfMotion", SetFunction="MOVD_setStateOfMotionnone", DataType="Enum: movementState_t")
AccStandstill = Ebikepkg_ACAL.Signal(StorageClass="ACAL_Prefix", DataType="typ_acceleration_10mm_ss_t")