% Simulink data dictionary CRCL_Dictionary.sldd
% references DU_DeviceLayerDictionary.sldd
% references DU_MotorControlDictionary.sldd
% references DU_ApplicationLayerDictionary.sldd

HPROX_HmiBikeSpeed = Simulink.Signal(StorageClass="GetSet", HeaderFile="HmiProxy.h", GetFunction="HPROX_getHmiBikeSpeed", SetFunction="HPROX_HmiBikeSpeedNONE", DataType="typ_speed_10m_h_t", Units="auto")
AccelerationTuningCounter = Ebikepkg_SMON.Signal(StorageClass="EbikePack", HeaderFile="SpeedMonitoring.h", DataType="uint8", Units="auto")
DecelerationTuningCounter = Ebikepkg_SMON.Signal(StorageClass="EbikePack", HeaderFile="SpeedMonitoring.h", DataType="uint8", Units="auto")
TransitionTuningCounter = Ebikepkg_SMON.Signal(StorageClass="EbikePack", HeaderFile="SpeedMonitoring.h", DataType="uint8", Units="auto")
GpsTuningCounter = Ebikepkg_SMON.Signal(StorageClass="EbikePack", HeaderFile="SpeedMonitoring.h", DataType="uint8", Units="auto")
AverageEnergyConsumption = Ebikepkg_SMON.Signal(StorageClass="EbikePack", HeaderFile="SpeedMonitoring.h", DataType="typ_energyPerDistance_mWh_km_t", Units="auto")
AverageEnergyFilterZ2 = Ebikepkg_SMON.Signal(StorageClass="EbikePack", HeaderFile="SpeedMonitoring.h", DataType="uint16", Units="auto")
AverageEnergyFilterZ3 = Ebikepkg_SMON.Signal(StorageClass="EbikePack", HeaderFile="SpeedMonitoring.h", DataType="uint16", Units="auto")
AverageEnergyFilterZ4 = Ebikepkg_SMON.Signal(StorageClass="EbikePack", HeaderFile="SpeedMonitoring.h", DataType="uint16", Units="auto")
AverageEnergyFilterZ1 = Ebikepkg_SMON.Signal(StorageClass="EbikePack", HeaderFile="SpeedMonitoring.h", DataType="uint16", Units="auto")
SMON_AccelerationTuningCounterInit = Ebikepkg_SMON.Signal(StorageClass="ImportFromFile", HeaderFile="SpeedMonitoring.h", DataType="uint8", Units="auto")
SMON_DecelerationTuningCounterInit = Ebikepkg_SMON.Signal(StorageClass="ImportFromFile", HeaderFile="SpeedMonitoring.h", DataType="uint8", Units="auto")
SMON_TransitionTuningCounterInit = Ebikepkg_SMON.Signal(StorageClass="ImportFromFile", HeaderFile="SpeedMonitoring.h", DataType="uint8", Units="auto")
SMON_GpsTuningCounterInit = Ebikepkg_SMON.Signal(StorageClass="ImportFromFile", HeaderFile="SpeedMonitoring.h", DataType="uint8", Units="auto")
SMON_AverageEnergyFilterZ1Init = Ebikepkg_SMON.Signal(StorageClass="ImportFromFile", HeaderFile="SpeedMonitoring.h", DataType="uint16", Units="auto")
SMON_AverageEnergyFilterZ2Init = Ebikepkg_SMON.Signal(StorageClass="ImportFromFile", HeaderFile="SpeedMonitoring.h", DataType="uint16", Units="auto")
SMON_AverageEnergyFilterZ3Init = Ebikepkg_SMON.Signal(StorageClass="ImportFromFile", HeaderFile="SpeedMonitoring.h", DataType="uint16", Units="auto")
SMON_AverageEnergyFilterZ4Init = Ebikepkg_SMON.Signal(StorageClass="ImportFromFile", HeaderFile="SpeedMonitoring.h", DataType="uint16", Units="auto")
SMON_StandStillActive = Ebikepkg_SMON.Signal(StorageClass="ImportFromFile", HeaderFile="SpeedMonitoring.h", DataType="boolean")
MAGF_getMagX = Ebikepkg_SMON.Signal(StorageClass="GetSet", HeaderFile="MagFieldMeasure.h", GetFunction="$N", SetFunction="$N_none", DataType="int16")
MAGF_getMagY = Ebikepkg_SMON.Signal(StorageClass="GetSet", HeaderFile="MagFieldMeasure.h", GetFunction="$N", SetFunction="$N_none", DataType="int16")
MAGPM_isMagPulsePlausible = Ebikepkg_SMON.Signal(StorageClass="ImportFromFile", HeaderFile="DrvEcu.h", DataType="boolean")
MAGF_getMagZ = Ebikepkg_SMON.Signal(StorageClass="GetSet", HeaderFile="MagFieldMeasure.h", GetFunction="$N", SetFunction="$N_none", DataType="int16")
MAGPM_isMagPulseUnPlausible = Ebikepkg_SMON.Signal(StorageClass="Reusable", HeaderFile="DrvEcu.h", DataType="boolean")
typ_rotation_mrads = Ebikepkg_ACAL.Signal(StorageClass="Default")
typ_acceleration_g = Ebikepkg_ACAL.Signal(StorageClass="Default")
angularRate_mDegreePerSecond_t = Simulink.NumericType(DataTypeMode="Fixed-point: slope and bias scaling", SignednessBool=true, WordLength=32, FixedExponent=0)
CRCL_abort = Simulink.Signal(StorageClass="ImportFromFile", DataType="int16")
CRCL_confidenceLevel = Simulink.Signal(StorageClass="ImportFromFile", DataType="int16")
CRCL_fire = Simulink.Signal(StorageClass="ImportFromFile", DataType="int16")
ROID_accBfXMg = Simulink.Signal(StorageClass="GetSet", HeaderFile="RotateImuData.h", GetFunction="ROID_getAccBfXMg", SetFunction="ROID_setAccBfXMg", DataType="int16")
ROID_accBfYMg = Simulink.Signal(StorageClass="GetSet", HeaderFile="RotateImuData.h", GetFunction="ROID_getAccBfYMg", SetFunction="ROID_setAccBfYMg", DataType="int16")
ROID_accBfZMg = Simulink.Signal(StorageClass="GetSet", HeaderFile="RotateImuData.h", GetFunction="ROID_getAccBfZMg", SetFunction="ROID_setAccBfZMg", DataType="int16")
ROID_gyrBfXMdegs = Simulink.Signal(StorageClass="GetSet", HeaderFile="RotateImuData.h", GetFunction="ROID_getGyrBfXMdegs", SetFunction="ROID_setGyrBfXMdegs", DataType="int32")
ROID_gyrBfYMdegs = Simulink.Signal(StorageClass="GetSet", HeaderFile="RotateImuData.h", GetFunction="ROID_getGyrBfYMdegs", SetFunction="ROID_setGyrBfYMdegs", DataType="int32")
ROID_gyrBfZMdegs = Simulink.Signal(StorageClass="GetSet", HeaderFile="RotateImuData.h", GetFunction="ROID_getGyrBfZMdegs", SetFunction="ROID_setGyrBfZMdegs", DataType="int32")
ROID_calibrationStatus = Simulink.Signal(StorageClass="GetSet", HeaderFile="RotateImuData.h", GetFunction="ROID_getCalibrationStatus", SetFunction="ROID_setCalibrationStatus", DataType="int16")
CRCL_systemConfig = Simulink.Signal(StorageClass="GetSet", HeaderFile="RotateImuData.h", GetFunction="CRCL_getSystemConfig", SetFunction="CRCL_setSystemConfig", DataType="int16")
CRCL_CobiHubConnection = Simulink.Signal(StorageClass="GetSet", HeaderFile="RotateImuData.h", GetFunction="CRCL_getCobiHubConnection", SetFunction="CRCL_setCobiHubConnection", DataType="int16")
COBI_hubSetup = Simulink.Signal(StorageClass="GetSet", HeaderFile="Sensordata.h", GetFunction="COBI_getHubSetup", SetFunction="set_$N", DataType="int16")
DU_accBfXmg = Simulink.Signal(StorageClass="GetSet", HeaderFile="Sensordata.h", GetFunction="DU_getAccBfXmg", SetFunction="set_$N", DataType="int16")
DU_accBfZmg = Simulink.Signal(StorageClass="GetSet", HeaderFile="Sensordata.h", GetFunction="DU_getAccBfZmg", SetFunction="set_$N", DataType="int16")
stepTime_s = Simulink.Parameter(0.01, StorageClass="Struct", StructName="CRCL_par", DataType="single")
calibrationDelayTime_s = Simulink.Parameter(2, StorageClass="Struct", StructName="CRCL_par", DataType="single")
longAccCompForEulerEstFlag = Simulink.Parameter(0, StorageClass="Struct", StructName="CRCL_par", DataType="uint16")
tipOverAngleThreshold_deg = Simulink.Parameter(50, StorageClass="Struct", StructName="CRCL_par", DataType="single")
tipOverAccZFiltTreshold_g = Simulink.Parameter(0.7, StorageClass="Struct", StructName="CRCL_par", DataType="single")
tipOverMinAccZFiltNoseOver_g = Simulink.Parameter(0.3, StorageClass="Struct", StructName="CRCL_par", DataType="single")
groundHitEnergyThresholdStanding_g2s2 = Simulink.Parameter(0.02, StorageClass="Struct", StructName="CRCL_par", DataType="single")
groundHitTipOverAngleThreshold_deg = Simulink.Parameter(40, StorageClass="Struct", StructName="CRCL_par", DataType="single")
collisionVarianceThreshold_g2 = Simulink.Parameter(8, StorageClass="Struct", StructName="CRCL_par", DataType="single")
strongHitSafetyFactor = Simulink.Parameter(2.5, StorageClass="Struct", StructName="CRCL_par", DataType="single")
scaleFactorVarianceStrongHit = Simulink.Parameter(2, StorageClass="Struct", StructName="CRCL_par", DataType="single")
minEnergyStrongHit_g2s2 = Simulink.Parameter(0.1, StorageClass="Struct", StructName="CRCL_par", DataType="single")
collisionAngleThreshold_deg = Simulink.Parameter(40, StorageClass="Struct", StructName="CRCL_par", DataType="single")
noMotionAccVarianceThresholdSD_g2 = Simulink.Parameter(0.001, StorageClass="Struct", StructName="CRCL_par", DataType="single")
ride1minSpeedSlow_kmh = Simulink.Parameter(4, StorageClass="Struct", StructName="CRCL_par", DataType="single")
ride2minSpeed_kmh = Simulink.Parameter(8, StorageClass="Struct", StructName="CRCL_par", DataType="single")
rroMinGyrX_degs = Simulink.Parameter(20, StorageClass="Struct", StructName="CRCL_par", DataType="single")
rroUniContinuityThreshold_degs = Simulink.Parameter(15, StorageClass="Struct", StructName="CRCL_par", DataType="single")
rroMaxSpeed_kmh = Simulink.Parameter(5, StorageClass="Struct", StructName="CRCL_par", DataType="single")
rroMonotonyThreshold_degs = Simulink.Parameter(-1, StorageClass="Struct", StructName="CRCL_par", DataType="single")
rroRollIntegrationAngleThreshold_degs = Simulink.Parameter(20, StorageClass="Struct", StructName="CRCL_par", DataType="single")
sdoMaxTipOverAngle_deg = Simulink.Parameter(20, StorageClass="Struct", StructName="CRCL_par", DataType="single")
sdoMinAccVar_g2 = Simulink.Parameter(8, StorageClass="Struct", StructName="CRCL_par", DataType="single")
sdoMinGyrXYNorm_degs = Simulink.Parameter(720, StorageClass="Struct", StructName="CRCL_par", DataType="single")
sdoScaleFactorOrientationChange = Simulink.Parameter(3, StorageClass="Struct", StructName="CRCL_par", DataType="single")
sdoMaxAccVarFreeFall_g2 = Simulink.Parameter(0.06, StorageClass="Struct", StructName="CRCL_par", DataType="single")
sdoMinGyrXYNormFreeFall_degs = Simulink.Parameter(100, StorageClass="Struct", StructName="CRCL_par", DataType="single")
cpMaxAbortTime_s = Simulink.Parameter(30, StorageClass="Struct", StructName="CRCL_par", DataType="single")
cpNumCrankRevolutionThreshold = Simulink.Parameter(5, StorageClass="Struct", StructName="CRCL_par", DataType="single")
cpMinEstDistance_m = Simulink.Parameter(50, StorageClass="Struct", StructName="CRCL_par", DataType="single")
cpMinRiddenTime_s = Simulink.Parameter(15, StorageClass="Struct", StructName="CRCL_par", DataType="single")
cpTimeOutSpeedCond2_s = Simulink.Parameter(15, StorageClass="Struct", StructName="CRCL_par", DataType="single")
cpSpeedCond2PositiveSpeedChangeTime_s = Simulink.Parameter(5, StorageClass="Struct", StructName="CRCL_par", DataType="single")
cpSpeedDerivativeThreshold_kmhs = Simulink.Parameter(0.005, StorageClass="Struct", StructName="CRCL_par", DataType="single")
cpMaxTipOverAngle_deg = Simulink.Parameter(35, StorageClass="Struct", StructName="CRCL_par", DataType="single")
tipOverRollPitchRelationNoseOver = Simulink.Parameter(1.5, StorageClass="Struct", StructName="CRCL_par", DataType="single")
sdoMinOrientationChange_deg = Simulink.Parameter(120, StorageClass="Struct", StructName="CRCL_par", DataType="single")

CrashClass = enum(DefaultValue="crashClassNoCrash")
  crashClassNoCrash = 0
  crashClass10 = 10  % ridingCollisionRollOver
  crashClass11 = 11  % ridingStrongHitNoTipOver
  crashClass12 = 12  % ridingCollisionNoseOver
  crashClass15 = 15  % ridingStrongHitRollOver
  crashClass16 = 16  % ridingStrongHitNoseOver
  crashClass20 = 20  % ridingRollOver
  crashClass22 = 22  % ridingNoseOver
  crashClass30 = 30  % lowSpeedRollOverGroundHit
  crashClass32 = 32  % lowSpeedNoseOverGroundHit
  crashClass33 = 33  % standingTipOverGroundHit
  crashClass40 = 40  % standingSoftHitTipOver
  crashClass41 = 41  % standingStrongHitNoTipOver
  crashClass44 = 44  % standingCollisionTipOver
  crashClass45 = 45  % standingStrongHitTipOver
  crashClass70 = 70  % riderlessRollOver
  crashClass80 = 80
  crashClass81 = 81
  crashClass82 = 82
  crashClass83 = 83
  crashClass84 = 84
  crashClass85 = 85
  crashClass90 = 90
  crashClass91 = 91
  crashClass92 = 92
  crashClass93 = 93
  crashClass94 = 94
  crashClass95 = 95

CRCL_scenario = Simulink.Signal(StorageClass="ImportFromFile", DataType="Enum: CrashClass")
CRCL_SdoFire = Simulink.Signal(StorageClass="ImportFromFile", DataType="uint8")
cpMinSpeedRiding_kmh = Simulink.Parameter(10, StorageClass="Struct", StructName="CRCL_par", DataType="single")
cpMinEstDistanceGnssBased_m = Simulink.Parameter(200, StorageClass="Struct", StructName="CRCL_par", DataType="single")