% Simulink data dictionary CobiCalibrationDD.sldd
% references CRCL_Dictionary.sldd

ENV_pressurePa = Simulink.Signal(StorageClass="GetSet", HeaderFile="Sensordata.h", GetFunction="ENV_getPressurePa", SetFunction="set_$N", DataType="int32")
ACC_accSfXmg = Simulink.Signal(StorageClass="GetSet", HeaderFile="Sensordata.h", GetFunction="ACC_getAccSfXmg", SetFunction="set_$N", DataType="int16")
ACC_accSfYmg = Simulink.Signal(StorageClass="GetSet", HeaderFile="Sensordata.h", GetFunction="ACC_getAccSfYmg", SetFunction="set_$N", DataType="int16")
ACC_accSfZmg = Simulink.Signal(StorageClass="GetSet", HeaderFile="Sensordata.h", GetFunction="ACC_getAccSfZmg", SetFunction="set_$N", DataType="int16")
Can_speedKmh = Simulink.Signal(StorageClass="GetSet", HeaderFile="Sensordata.h", GetFunction="Can_getSpeedKmh", SetFunction="set_$N", DataType="uint16")
COCA_accBfXmg = Simulink.Signal(StorageClass="ImportFromFile", DataType="int16")
COCA_accBfYmg = Simulink.Signal(StorageClass="ImportFromFile", DataType="int16")
COCA_accBfZmg = Simulink.Signal(StorageClass="ImportFromFile", DataType="int16")
COCA_gyrBfXmdegs = Simulink.Signal(StorageClass="ImportFromFile", DataType="int32")
COCA_gyrBfYmdegs = Simulink.Signal(StorageClass="ImportFromFile", DataType="int32")
COCA_gyrBfZmdegs = Simulink.Signal(StorageClass="ImportFromFile", DataType="int32")
GYR_gyrSfXmdegs = Simulink.Signal(StorageClass="GetSet", HeaderFile="Sensordata.h", GetFunction="GYR_getGyrSfXmdegs", SetFunction="set_$N", DataType="int32")
GYR_gyrSfYmdegs = Simulink.Signal(StorageClass="GetSet", HeaderFile="Sensordata.h", GetFunction="GYR_getGyrSfYmdegs", SetFunction="set_$N", DataType="int32")
GYR_gyrSfZmdegs = Simulink.Signal(StorageClass="GetSet", HeaderFile="Sensordata.h", GetFunction="GYR_getGyrSfZmdegs", SetFunction="set_$N", DataType="int32")
COCA_calibrationFlag = Simulink.Signal(StorageClass="ImportFromFile", DataType="int16")
COCA_os = Simulink.Signal(StorageClass="GetSet", GetFunction="COCA_getOs", SetFunction="set_$N", DataType="int16")
COCA_initMountingSetup = Simulink.Signal(StorageClass="GetSet", GetFunction="COCA_getInitMountingSetup", SetFunction="set_$N", DataType="int16")
COCA_mountingSetup = Simulink.Signal(StorageClass="ImportFromFile", DataType="int16")
COCA_initMountingAngleDeg = Simulink.Signal(StorageClass="GetSet", GetFunction="COCA_getInitMountingAngleDeg", SetFunction="set_$N", DataType="single")
COCA_mountingAngleDeg = Simulink.Signal(StorageClass="ImportFromFile", DataType="single")
CRCL_crashScenario = Simulink.Signal(StorageClass="GetSet", HeaderFile="CRCL.h", GetFunction="CRCL_getScenario", SetFunction="CRCL_setScenario", DataType="Enum: CrashClass")