% Simulink data dictionary DU_ApplicationLayerDictionary.sldd
% references DataTypeDictionary.sldd

SPDC_PresentBikeSpeedInternal = Simulink.Signal(StorageClass="GetSet", HeaderFile="SpeedOdoCalc.h", GetFunction="SPDC_getPresentBikeSpeedInternal", SetFunction="SPDC_setPresentBikeSpeedInternalNONE", DataType="typ_speed_10m_h_t")
SPDC_PresentBikeSpeedHmi = Simulink.Signal(StorageClass="GetSet", HeaderFile="SpeedOdoCalc.h", GetFunction="SPDC_getPresentBikeSpeedHmi", SetFunction="SPDC_setPresentBikeSpeedHmiNONE", DataType="typ_speed_10m_h_t")
SPDC_Odometer = Simulink.Signal(StorageClass="GetSet", HeaderFile="SpeedOdoCalc.h", GetFunction="SPDC_getOdometer", SetFunction="none16", DataType="typ_distance_m_t")
SPDC_PresentBikeSpeednMotor = Simulink.Signal(StorageClass="GetSet", HeaderFile="SpeedOdoCalc.h", GetFunction="SPDC_getPresentBikeSpeednMotor", SetFunction="SPDC_setPresentBikeSpeednMotorNONE", DataType="typ_speed_10m_h_t")
DRVC_BikeType = Simulink.Signal(StorageClass="GetSet", HeaderFile="DriveController.h", GetFunction="DRVC_getBikeType", SetFunction="DRVC_setBikeTypeNONE", DataType="Enum: bikeType_t")
ACAL_AccOrthogonalDrivingDirection = Simulink.Signal(StorageClass="GetSet", HeaderFile="AccelerationCalc.h", GetFunction="ACAL_getAccOrthogonalDrivingDirection", SetFunction="ACAL_AccOrthogonalDrivingDirectionNONE", DataType="typ_acceleration_10mm_ss_t")
TOPL_getDriverTorque = Simulink.Signal(StorageClass="GetSet", HeaderFile="TorquePlausibility.h", GetFunction="TOPL_getDriverTorque", SetFunction="TOPL_setDriverTorqueNONE", DataType="typ_torque_100mNm_t", Units="auto")
SPDC_UserWheelCircumference = Simulink.Signal(StorageClass="GetSet", HeaderFile="SpeedOdoCalc.h", GetFunction="SPDC_getUserWheelCircumference", SetFunction="SPDC_setUserWheelCircumferenceNONE", DataType="typ_distanceShort_mm_t", Units="auto", InitialValue="2.2")
TOPL_getDriverTorqueFiltered = Simulink.Signal(StorageClass="GetSet", HeaderFile="TorquePlausibility.h", GetFunction="TOPL_getDriverTorqueFiltered", SetFunction="TOPL_setDriverTorqueFilteredNONE", DataType="typ_torque_100mNm_t", Units="auto")
HPROX_isWalkAssistActivated = Simulink.Signal(StorageClass="GetSet", HeaderFile="HmiProxy.h", GetFunction="HPROX_isWalkAssistActivated", SetFunction="HPROX_setWalkAssistActivatedNONE", DataType="boolean", Units="auto")
ACAL_getAccDrivingDirection = Simulink.Signal(StorageClass="GetSet", HeaderFile="AccelerationCalc.h", GetFunction="ACAL_getAccDrivingDirection", SetFunction="ACAL_setAccDrivingDirectionNONE", DataType="typ_acceleration_10mm_ss_t", Units="auto")
ACAL_isBikeUpsideDown = Simulink.Signal(StorageClass="GetSet", HeaderFile="AccelerationCalc.h", GetFunction="ACAL_isBikeUpsideDown", SetFunction="ACAL_setBikeUpsideDownNONE", DataType="bool_t", Units="auto")
ACAL_getStandardDeviationAccOrthogonal = Simulink.Signal(StorageClass="GetSet", HeaderFile="AccelerationCalc.h", GetFunction="$N", SetFunction="$N_None", DataType="typ_acceleration_10mm_ss_t", Units="auto")
ACAL_getAccBasedBikeSpeed = Simulink.Signal(StorageClass="GetSet", HeaderFile="AccelerationCalc.h", GetFunction="$N", SetFunction="$N_NONE", DataType="typ_speed_10m_h_t", Units="auto")
PTCO_FULL_MOTOR_SUPPORT = Simulink.Parameter(1, StorageClass="ImportedDefine", HeaderFile="PowerTorqueCoordinator.h", DataType="typ_ratio_10m_t", Units="auto")
PTCO_NO_MOTOR_SUPPORT = Simulink.Parameter(0, StorageClass="ImportedDefine", HeaderFile="PowerTorqueCoordinator.h", DataType="typ_ratio_10m_t", Units="auto")
ACAL_getInstallationAngle = Simulink.Signal(StorageClass="GetSet", HeaderFile="AccelerationCalc.h", GetFunction="$N", SetFunction="$N_NONE", DataType="typ_angle_mrad_t", Units="auto")
CADE_getDriverCadence = Simulink.Signal(StorageClass="GetSet", HeaderFile="CadenceCalc.h", GetFunction="CADE_getDriverCadence", SetFunction="CADE_setDriverCadencenone", DataType="typ_revolutionRate_1_min_t")
SPDC_getSecondSpeedSignal = Simulink.Signal(StorageClass="GetSet", HeaderFile="SpeedOdoCalc.h", GetFunction="$N", SetFunction="$N_none", DataType="typ_speed_10m_h_t")
ACAL_getPresentSlope = Simulink.Signal(StorageClass="GetSet", HeaderFile="AccelerationCalc.h", GetFunction="$N", SetFunction="set_$N_None", DataType="typ_ratio_10m_t")
ACAL_getAccStandstill = Simulink.Signal(StorageClass="GetSet", HeaderFile="AccelerationCalc.h", GetFunction="ACAL_getAccStandstill", SetFunction="ACAL_setAccStandstillNone", DataType="typ_acceleration_10mm_ss_t")