% Simulink data dictionary DU_DeviceLayerDictionary.sldd
% references DataTypeDictionary.sldd

TORM_TimeWithinTolerance = Simulink.Signal(StorageClass="GetSet", HeaderFile="TorqueMeasure.h", GetFunction="TORM_getTimeWithinTolerance", SetFunction="TORM_setTimeWithinToleranceNONE", DataType="typ_duration_ms_t")
TORM_DriverTorque = Simulink.Signal(StorageClass="GetSet", HeaderFile="TorqueMeasure.h", GetFunction="TORM_getDriverTorque", SetFunction="TORM_setDriverTorqueNONE", DataType="typ_torque_100mNm_t")
VOLT_DuSupplyVoltage = Simulink.Signal(StorageClass="GetSet", HeaderFile="VoltageMeasure.h", GetFunction="VOLT_getDuSupplyVoltage", SetFunction="VOLT_setDuSupplyVoltageNONE", DataType="typ_voltage_mV_t")
BPROX_TotalPresentAllowedDischargeCurrent = Simulink.Signal(StorageClass="GetSet", HeaderFile="BatteryProxy.h", GetFunction="BPROX_getTotalPresentAllowedDischargeCurrent", SetFunction="BPROX_setTotalPresentAllowedDischargeCurrentNONE", DataType="typ_current_100mA_t")
BPROX_BatteryTotalPresentCurrent = Simulink.Signal(StorageClass="GetSet", HeaderFile="BatteryProxy.h", GetFunction="BPROX_getTotalPresentCurrent", SetFunction="BPROX_setTotalPresentCurrentNONE", DataType="typ_current_mA_t")
ACC_AccX = Simulink.Signal(StorageClass="GetSet", HeaderFile="AccMeasure.h", GetFunction="ACC_getAccX", SetFunction="none3", DataType="typ_acceleration_10mm_ss_t", Min=0)
ACC_AccY = Simulink.Signal(StorageClass="GetSet", HeaderFile="AccMeasure.h", GetFunction="ACC_getAccY", SetFunction="none4", DataType="typ_acceleration_10mm_ss_t", Min=0)
HPROX_AssistanceMode = Simulink.Signal(StorageClass="GetSet", HeaderFile="HmiProxy.h", GetFunction="HPROX_getAssistanceMode", SetFunction="HPROX_setAssistanceModenone", DataType="Enum: assistMode_t")
HPROX_DriveOffRequest = Simulink.Signal(StorageClass="GetSet", HeaderFile="HmiProxy.h", GetFunction="HPROX_getDriveOffRequest", SetFunction="HPROX_setDriveOffRequestnone", DataType="typ_driveOffRequest_t")
GEAM_MaxChainring2RearWheelRatio = Simulink.Signal(StorageClass="GetSet", HeaderFile="GearMeasure.h", GetFunction="GEAM_getMaxChainring2RearWheelRatio", SetFunction="GEAM_setMaxChainring2RearWheelRatioNONE", DataType="typ_ratio_1m_t", InitialValue="1.64")
GEAM_MinChainring2RearWheelRatio = Simulink.Signal(StorageClass="GetSet", HeaderFile="GearMeasure.h", GetFunction="GEAM_getMinChainring2RearWheelRatio", SetFunction="GEAM_setMinChainring2RearWheelRatioNONE", DataType="typ_ratio_1m_t", InitialValue="0.4")
GEAM_Pedal2FrontChainringRatio = Simulink.Signal(StorageClass="GetSet", HeaderFile="GearMeasure.h", GetFunction="GEAM_getPedal2FrontChainringRatio", SetFunction="GEAM_setPedal2FrontChainringRatioNONE", DataType="typ_ratio_1m_t", InitialValue="2.52")
LGHT_LightStatus = Simulink.Signal(StorageClass="GetSet", HeaderFile="LightControl.h", GetFunction="LGHT_getLightStatus", SetFunction="LGHT_setLightStatusNONE", DataType="Enum: lightStatus_t")
ACC_AccZ = Simulink.Signal(StorageClass="GetSet", HeaderFile="AccMeasure.h", GetFunction="ACC_getAccZ", SetFunction="ACC_setAccZnone", DataType="typ_acceleration_10mm_ss_t", Min=0, Units="auto")
CURRM_getPresentDriveUnitInputCurrent = Simulink.Signal(StorageClass="GetSet", HeaderFile="CurrentMeasure.h", GetFunction="$N", SetFunction="$N_none", DataType="typ_current_mA_t", Units="auto")  % ONLY BDU3XX!!!!!
TEMP_getPresentPcbTemperature = Simulink.Signal(StorageClass="GetSet", HeaderFile="TempMeasure.h", GetFunction="$N", SetFunction="$N_none", DataType="typ_temperature_10mK_t", Units="auto")
GEAM_GearRatioMotorCrank = Simulink.Signal(StorageClass="GetSet", HeaderFile="GearMeasure.h", GetFunction="GEAM_getGearRatioMotorCrank", SetFunction="GEAM_setGearRatioMotorCrankNONE", DataType="typ_gearRatio_1m_t")
SPECO_getPresentSpeed = Simulink.Signal(StorageClass="GetSet", HeaderFile="SpeedCoordinator.h", GetFunction="SPECO_getPresentSpeed", SetFunction="SPECO_setPresentSpeedNONE", DataType="typ_speed_10m_h_t")
SPECO_getOemWheelCircumference = Simulink.Signal(StorageClass="GetSet", HeaderFile="SpeedCoordinator.h", GetFunction="SPECO_getOemWheelCircumference", SetFunction="SPECO_setOemWheelCircumferenceNONE", DataType="typ_distanceShort_mm_t", InitialValue="2.18")
SNDC_isPlayingSound = Simulink.Signal(StorageClass="GetSet", HeaderFile="SoundControl.h", GetFunction="SNDC_isPlayingSound", SetFunction="SNDC_isPlayingSoundNONE", DataType="bool_t", InitialValue="2.18")