% Simulink data dictionary DU_MotorControlDictionary.sldd
% references DataTypeDictionary.sldd

MOTC_UdMotorVoltage = Simulink.Signal(StorageClass="GetSet", HeaderFile="MotorControl.h", GetFunction="MOTC_getUdMotorVoltage", SetFunction="MOTC_setUdMotorVoltageNONE", DataType="typ_current_mA_t")
MOTC_MotorTorquePresent = Simulink.Signal(StorageClass="GetSet", HeaderFile="MotorControl.h", GetFunction="MOTC_getMotorTorquePresent", SetFunction="MOTC_setMotorTorquePresentNONE", DataType="typ_torque_mNm_t", Min=-32)
MOTC_MotorTorqueRequest = Simulink.Signal(StorageClass="GetSet", HeaderFile="MotorControl.h", GetFunction="MOTC_getMotorTorqueRequest", SetFunction="MOTC_setMotorTorqueRequest", DataType="typ_torque_mNm_t")
MOTC_MaxMotorTorque = Simulink.Parameter(5, StorageClass="GetSet", HeaderFile="MotorControl.h", GetFunction="MOTC_getMaxMotorTorque", SetFunction="MOTC_setMaxMotorTorquenone", DataType="typ_torque_mNm_t", Min=-32)
MOTC_IdMotorCurrent = Simulink.Signal(StorageClass="GetSet", HeaderFile="MotorControl.h", GetFunction="MOTC_getIdMotorCurrent", SetFunction="MOTC_setIdMotorCurrentNONE", DataType="typ_current_mA_t")
MOTC_IqMotorCurrent = Simulink.Signal(StorageClass="GetSet", HeaderFile="MotorControl.h", GetFunction="MOTC_getIqMotorCurrent", SetFunction="MOTC_setIqMotorCurrentNONE", DataType="typ_current_mA_t")
MOTC_NMotorPresent = Simulink.Signal(StorageClass="GetSet", HeaderFile="MotorControl.h", GetFunction="MOTC_getNMotorPresent", SetFunction="MOTC_setNMotorPresentNONE", DataType="typ_revolutionRate_1_min_t")
MOTC_UqMotorVoltage = Simulink.Signal(StorageClass="GetSet", HeaderFile="MotorControl.h", GetFunction="MOTC_getUqMotorVoltage", SetFunction="MOTC_setUqMotorVoltageNONE", DataType="typ_current_mA_t")
MOTC_MotorPowerPresent = Simulink.Signal(StorageClass="GetSet", HeaderFile="MotorControl.h", GetFunction="MOTC_getMotorPowerPresent", SetFunction="MOTC_setMotorPowerPresentNONE", DataType="typ_power_100mW_t")
MOTC_getMaxPeakMotorPower = Simulink.Signal(StorageClass="GetSet", HeaderFile="MotorControl.h", GetFunction="$N", SetFunction="$N_none", DataType="typ_power_100mW_t", Units="auto")