% Simulink data dictionary DataTypeDictionary.sldd

bool_t = Simulink.AliasType(BaseType="boolean", HeaderFile="BaseTypes.h")
s16_t = Simulink.AliasType(BaseType="int16", HeaderFile="BaseTypes.h")
s32_t = Simulink.AliasType(BaseType="int32", HeaderFile="BaseTypes.h")
s8_t = Simulink.AliasType(BaseType="int8", HeaderFile="BaseTypes.h")
typ_angularAcceleration_100mrpm_ms_t = Simulink.NumericType(DataTypeMode="Fixed-point: slope and bias scaling", SignednessBool=true, WordLength=16, FixedExponent=-4, SlopeAdjustmentFactor=1.6, HeaderFile="Commons.h")
typ_assistGain_10m_t = Simulink.NumericType(DataTypeMode="Fixed-point: slope and bias scaling", SignednessBool=false, WordLength=16, FixedExponent=-7, SlopeAdjustmentFactor=1.28, HeaderFile="Commons.h")
typ_bikeType_t = Simulink.AliasType(BaseType="Enum: ENUM_BIKE_TYPE", HeaderFile="Commons.h")
typ_coefficient_1m_t = Simulink.NumericType(DataTypeMode="Fixed-point: slope and bias scaling", SignednessBool=false, WordLength=16, FixedExponent=-10, SlopeAdjustmentFactor=1.024, HeaderFile="Commons.h")
typ_current_mA_t = Simulink.NumericType(DataTypeMode="Fixed-point: slope and bias scaling", SignednessBool=true, WordLength=32, FixedExponent=-10, SlopeAdjustmentFactor=1.024, HeaderFile="Commons.h")
typ_distanceShort_mm_t = Simulink.NumericType(DataTypeMode="Fixed-point: slope and bias scaling", SignednessBool=false, WordLength=16, FixedExponent=-10, SlopeAdjustmentFactor=1.024, HeaderFile="Commons.h")
typ_drvCadence_1_min_t = Simulink.NumericType(DataTypeMode="Fixed-point: slope and bias scaling", SignednessBool=true, WordLength=16, FixedExponent=0, HeaderFile="Commons.h")
typ_power_100mW_t = Simulink.NumericType(DataTypeMode="Fixed-point: slope and bias scaling", SignednessBool=false, WordLength=16, FixedExponent=-4, SlopeAdjustmentFactor=1.6, HeaderFile="Commons.h")
typ_ratio_100u_t = Simulink.NumericType(DataTypeMode="Fixed-point: slope and bias scaling", SignednessBool=true, WordLength=16, FixedExponent=-14, SlopeAdjustmentFactor=1.6384, HeaderFile="Commons.h")
typ_ratio_10m_t = Simulink.NumericType(DataTypeMode="Fixed-point: slope and bias scaling", SignednessBool=true, WordLength=8, FixedExponent=-7, SlopeAdjustmentFactor=1.28, HeaderFile="Commons.h")
typ_ratio_1m_t = Simulink.NumericType(DataTypeMode="Fixed-point: slope and bias scaling", SignednessBool=true, WordLength=16, FixedExponent=-10, SlopeAdjustmentFactor=1.024, HeaderFile="Commons.h")
typ_revolutionRate_1_min_t = Simulink.NumericType(DataTypeMode="Fixed-point: slope and bias scaling", SignednessBool=true, WordLength=16, FixedExponent=0, HeaderFile="Commons.h")
typ_revolutionSlewRate_1_s2_t = Simulink.NumericType(DataTypeMode="Fixed-point: slope and bias scaling", SignednessBool=false, WordLength=16, FixedExponent=0, HeaderFile="Commons.h")
typ_speed_10m_h_t = Simulink.NumericType(DataTypeMode="Fixed-point: slope and bias scaling", SignednessBool=false, WordLength=16, FixedExponent=-7, SlopeAdjustmentFactor=1.28, HeaderFile="Commons.h")
typ_torque_100mNm_t = Simulink.NumericType(DataTypeMode="Fixed-point: slope and bias scaling", SignednessBool=true, WordLength=16, FixedExponent=-4, SlopeAdjustmentFactor=1.6, HeaderFile="Commons.h")
typ_torque_mNm_t = Simulink.NumericType(DataTypeMode="Fixed-point: slope and bias scaling", SignednessBool=true, WordLength=16, FixedExponent=-10, SlopeAdjustmentFactor=1.024, HeaderFile="Commons.h")
u16_t = Simulink.AliasType(BaseType="uint16", HeaderFile="BaseTypes.h")
u32_t = Simulink.AliasType(BaseType="uint32", HeaderFile="BaseTypes.h")
u8_t = Simulink.AliasType(BaseType="uint8", HeaderFile="BaseTypes.h")
typ_current_100mA_t = Simulink.NumericType(DataTypeMode="Fixed-point: slope and bias scaling", SignednessBool=false, WordLength=16, FixedExponent=-4, SlopeAdjustmentFactor=1.6, HeaderFile="Commons.h")
typ_voltageBipolar_mV_t = Simulink.NumericType(DataTypeMode="Fixed-point: slope and bias scaling", SignednessBool=true, WordLength=16, FixedExponent=-10, SlopeAdjustmentFactor=1.024, HeaderFile="Commons.h")
typ_voltage_mV_t = Simulink.NumericType(DataTypeMode="Fixed-point: slope and bias scaling", SignednessBool=false, WordLength=16, FixedExponent=-10, SlopeAdjustmentFactor=1.024, HeaderFile="Commons.h")
typ_angle_mrad_t = Simulink.NumericType(DataTypeMode="Fixed-point: slope and bias scaling", SignednessBool=true, WordLength=16, FixedExponent=-10, SlopeAdjustmentFactor=1.024)
typ_acceleration_10mm_ss_t = Simulink.NumericType(DataTypeMode="Fixed-point: slope and bias scaling", SignednessBool=true, WordLength=16, FixedExponent=-7, SlopeAdjustmentFactor=1.28)
typ_duration_ms_t = Simulink.NumericType(DataTypeMode="Fixed-point: slope and bias scaling", SignednessBool=false, WordLength=16, FixedExponent=-10, SlopeAdjustmentFactor=1.024, HeaderFile="Commons.h")
typ_driveOffRequest_t = Simulink.NumericType(DataTypeMode="Fixed-point: slope and bias scaling", SignednessBool=false, WordLength=8, FixedExponent=0)  % Type for the drive off request.
typ_walkAssistRequest_t = Simulink.NumericType(DataTypeMode="Fixed-point: slope and bias scaling", SignednessBool=false, WordLength=8, FixedExponent=0)  % Type for the walk assist request.
typ_distance_m_t = Simulink.NumericType(DataTypeMode="Fixed-point: slope and bias scaling", SignednessBool=false, WordLength=32, FixedExponent=0)
typ_gearShiftMode_t = Simulink.AliasType(BaseType="Enum: ENUM_GEAR_SHIFT_MODE", HeaderFile="Commons.h")
typ_durationSigned_ms_t = Simulink.NumericType(DataTypeMode="Fixed-point: slope and bias scaling", SignednessBool=true, WordLength=16, FixedExponent=0)
typ_durationLong_ms_t = Simulink.NumericType(DataTypeMode="Fixed-point: slope and bias scaling", SignednessBool=false, WordLength=32, FixedExponent=-10, SlopeAdjustmentFactor=1.024)
typ_bikeGear_t = Simulink.NumericType(DataTypeMode="Fixed-point: slope and bias scaling", SignednessBool=false, WordLength=8, FixedExponent=0)
typ_revolutionSlewRate_100m_s2_t = Simulink.NumericType(DataTypeMode="Fixed-point: slope and bias scaling", SignednessBool=false, WordLength=16, FixedExponent=-4, SlopeAdjustmentFactor=1.6, HeaderFile="Commons.h")
typ_gearShiftRec_t = Simulink.NumericType(DataTypeMode="Fixed-point: slope and bias scaling", SignednessBool=true, WordLength=8, FixedExponent=-7, SlopeAdjustmentFactor=1.28)
typ_duration_100ms_t = Simulink.NumericType(DataTypeMode="Fixed-point: slope and bias scaling", SignednessBool=true, WordLength=8, FixedExponent=-4, SlopeAdjustmentFactor=1.6)
typ_temperature_10mK_t = Simulink.NumericType(DataTypeMode="Fixed-point: slope and bias scaling", SignednessBool=false, WordLength=16, FixedExponent=-7, SlopeAdjustmentFactor=1.28, HeaderFile="Commons.h")
typ_gearRatio_1m_t = Simulink.NumericType(DataTypeMode="Fixed-point: slope and bias scaling", SignednessBool=false, WordLength=16, FixedExponent=-10, SlopeAdjustmentFactor=1.024, HeaderFile="Commons.h")