% Simulink data dictionary MOCA_DD.sldd

ACC_accSfXmg = Simulink.Signal(StorageClass="GetSet", HeaderFile="Sensordata.h", GetFunction="ACC_getAccSfXmg", SetFunction="set_$N", DataType="int16")
ACC_accSfYmg = Simulink.Signal(StorageClass="GetSet", HeaderFile="Sensordata.h", GetFunction="ACC_getAccSfYmg", SetFunction="set_$N", DataType="int16")
ACC_accSfZmg = Simulink.Signal(StorageClass="GetSet", HeaderFile="Sensordata.h", GetFunction="ACC_getAccSfZmg", SetFunction="set_$N", DataType="int16")
COBI_hubSetup = Simulink.Signal(StorageClass="GetSet", HeaderFile="Sensordata.h", GetFunction="COBI_getHubSetup", SetFunction="set_$N", DataType="int16")
COCA_accBfXmg = Simulink.Signal(StorageClass="ImportFromFile", DataType="int16")
COCA_accBfYmg = Simulink.Signal(StorageClass="ImportFromFile", DataType="int16")
COCA_accBfZmg = Simulink.Signal(StorageClass="ImportFromFile", DataType="int16")
COCA_calibrationFlag = Simulink.Signal(StorageClass="ImportFromFile", DataType="int16")
COCA_gyrBfXmdegs = Simulink.Signal(StorageClass="ImportFromFile", DataType="int32")
COCA_gyrBfYmdegs = Simulink.Signal(StorageClass="ImportFromFile", DataType="int32")
COCA_gyrBfZmdegs = Simulink.Signal(StorageClass="ImportFromFile", DataType="int32")
COCA_os = Simulink.Signal(StorageClass="GetSet", GetFunction="COCA_getOs", SetFunction="set_$N", DataType="int16")
ENV_pressurePa = Simulink.Signal(StorageClass="GetSet", HeaderFile="Sensordata.h", GetFunction="ENV_getPressurePa", SetFunction="set_$N", DataType="int32")
GYR_gyrSfXmdegs = Simulink.Signal(StorageClass="GetSet", HeaderFile="Sensordata.h", GetFunction="GYR_getGyrSfXmdegs", SetFunction="set_$N", DataType="int32")
GYR_gyrSfYmdegs = Simulink.Signal(StorageClass="GetSet", HeaderFile="Sensordata.h", GetFunction="GYR_getGyrSfYmdegs", SetFunction="set_$N", DataType="int32")
GYR_gyrSfZmdegs = Simulink.Signal(StorageClass="GetSet", HeaderFile="Sensordata.h", GetFunction="GYR_getGyrSfZmdegs", SetFunction="set_$N", DataType="int32")
SPECO_getPresentSpeed = Simulink.Signal(StorageClass="GetSet", HeaderFile="SpeedCoordinator.h", GetFunction="SPECO_getPresentSpeed", SetFunction="SPECO_setPresentSpeedNONE", DataType="typ_speed_10m_h_t")
typ_speed_10m_h_t = Simulink.NumericType(DataTypeMode="Fixed-point: slope and bias scaling", SignednessBool=false, WordLength=16, FixedExponent=-7, SlopeAdjustmentFactor=1.28, HeaderFile="Commons.h")
samplePeriod_s = Simulink.Parameter(0.01, StorageClass="Struct", StructName="MOCA_par", DataType="single")
maxAngleChange_deg = Simulink.Parameter(10, StorageClass="Struct", StructName="MOCA_par", DataType="single")
minLongAccNorm_mg = Simulink.Parameter(100, StorageClass="Struct", StructName="MOCA_par", DataType="single")
initRotMatSf2Bf_3x3 = Simulink.Signal(StorageClass="Struct", StructName="MOCA_in", DataType="single", Dimensions=[3 3], InitialValue="eye(3,3)")
maxLongAccNorm_mg = Simulink.Parameter(600, StorageClass="Struct", StructName="MOCA_par", DataType="single")
minSpeedRSD_kmh = Simulink.Parameter(15, StorageClass="Struct", StructName="MOCA_par", DataType="single")
rotMatUpdate = Simulink.Signal(StorageClass="Struct", StructName="MOCA_out", DataType="int16", InitialValue="0")
rotMatSf2BfOut_3x3 = Simulink.Signal(StorageClass="Struct", StructName="MOCA_out", DataType="single", Dimensions=[3 3], InitialValue="eye(3,3)")