% Simulink data dictionary SMON_Dictionary.sldd
% references DU_DeviceLayerDictionary.sldd
% references DU_MotorControlDictionary.sldd
% references DU_ApplicationLayerDictionary.sldd

HPROX_HmiBikeSpeed = Simulink.Signal(StorageClass="GetSet", HeaderFile="HmiProxy.h", GetFunction="HPROX_getHmiBikeSpeed", SetFunction="HPROX_HmiBikeSpeedNONE", DataType="typ_speed_10m_h_t", Units="auto")
AccelerationTuningCounter = Ebikepkg_SMON.Signal(StorageClass="EbikePack", HeaderFile="SpeedMonitoring.h", DataType="uint8", Units="auto")
DecelerationTuningCounter = Ebikepkg_SMON.Signal(StorageClass="EbikePack", HeaderFile="SpeedMonitoring.h", DataType="uint8", Units="auto")
TransitionTuningCounter = Ebikepkg_SMON.Signal(StorageClass="EbikePack", HeaderFile="SpeedMonitoring.h", DataType="uint8", Units="auto")
GpsTuningCounter = Ebikepkg_SMON.Signal(StorageClass="EbikePack", HeaderFile="SpeedMonitoring.h", DataType="uint8", Units="auto")
AverageEnergyConsumption = Ebikepkg_SMON.Signal(StorageClass="EbikePack", HeaderFile="SpeedMonitoring.h", DataType="typ_energyPerDistance_mWh_km_t", Units="auto")
AverageEnergyFilterZ2 = Ebikepkg_SMON.Signal(StorageClass="EbikePack", HeaderFile="SpeedMonitoring.h", DataType="uint16", Units="auto")
AverageEnergyFilterZ3 = Ebikepkg_SMON.Signal(StorageClass="EbikePack", HeaderFile="SpeedMonitoring.h", DataType="uint16", Units="auto")
AverageEnergyFilterZ4 = Ebikepkg_SMON.Signal(StorageClass="EbikePack", HeaderFile="SpeedMonitoring.h", DataType="uint16", Units="auto")
AverageEnergyFilterZ1 = Ebikepkg_SMON.Signal(StorageClass="EbikePack", HeaderFile="SpeedMonitoring.h", DataType="uint16", Units="auto")
SMON_AccelerationTuningCounterInit = Ebikepkg_SMON.Signal(StorageClass="ImportFromFile", HeaderFile="SpeedMonitoring.h", DataType="uint8", Units="auto")
SMON_DecelerationTuningCounterInit = Ebikepkg_SMON.Signal(StorageClass="ImportFromFile", HeaderFile="SpeedMonitoring.h", DataType="uint8", Units="auto")
SMON_TransitionTuningCounterInit = Ebikepkg_SMON.Signal(StorageClass="ImportFromFile", HeaderFile="SpeedMonitoring.h", DataType="uint8", Units="auto")
SMON_GpsTuningCounterInit = Ebikepkg_SMON.Signal(StorageClass="ImportFromFile", HeaderFile="SpeedMonitoring.h", DataType="uint8", Units="auto")
SMON_AverageEnergyFilterZ1Init = Ebikepkg_SMON.Signal(StorageClass="ImportFromFile", HeaderFile="SpeedMonitoring.h", DataType="uint16", Units="auto")
SMON_AverageEnergyFilterZ2Init = Ebikepkg_SMON.Signal(StorageClass="ImportFromFile", HeaderFile="SpeedMonitoring.h", DataType="uint16", Units="auto")
SMON_AverageEnergyFilterZ3Init = Ebikepkg_SMON.Signal(StorageClass="ImportFromFile", HeaderFile="SpeedMonitoring.h", DataType="uint16", Units="auto")
SMON_AverageEnergyFilterZ4Init = Ebikepkg_SMON.Signal(StorageClass="ImportFromFile", HeaderFile="SpeedMonitoring.h", DataType="uint16", Units="auto")
typ_energyPerDistance_mWh_km_t = Simulink.NumericType(DataTypeMode="Fixed-point: slope and bias scaling", SignednessBool=false, WordLength=16, FixedExponent=-10, SlopeAdjustmentFactor=1.024)
SMON_StandStillActive = Ebikepkg_SMON.Signal(StorageClass="ImportFromFile", HeaderFile="SpeedMonitoring.h", DataType="boolean")