% Simulink data dictionary SensorDataMonitorDD.sldd

ENV_pressurePa = Simulink.Signal(StorageClass="GetSet", HeaderFile="Sensordata.h", GetFunction="ENV_getPressurePa", SetFunction="set_$N", DataType="int32")
ACC_accSfXmg = Simulink.Signal(StorageClass="GetSet", HeaderFile="Sensordata.h", GetFunction="ACC_getAccSfXmg", SetFunction="set_$N", DataType="int16")
ACC_accSfYmg = Simulink.Signal(StorageClass="GetSet", HeaderFile="Sensordata.h", GetFunction="ACC_getAccSfYmg", SetFunction="set_$N", DataType="int16")
ACC_accSfZmg = Simulink.Signal(StorageClass="GetSet", HeaderFile="Sensordata.h", GetFunction="ACC_getAccSfZmg", SetFunction="set_$N", DataType="int16")
Can_speedKmh = Simulink.Signal(StorageClass="GetSet", HeaderFile="Sensordata.h", GetFunction="Can_getSpeedKmh", SetFunction="set_$N", DataType="uint16")
GYR_gyrSfXmdegs = Simulink.Signal(StorageClass="GetSet", HeaderFile="Sensordata.h", GetFunction="GYR_getGyrSfXmdegs", SetFunction="set_$N", DataType="int32")
GYR_gyrSfYmdegs = Simulink.Signal(StorageClass="GetSet", HeaderFile="Sensordata.h", GetFunction="GYR_getGyrSfYmdegs", SetFunction="set_$N", DataType="int32")
GYR_gyrSfZmdegs = Simulink.Signal(StorageClass="GetSet", HeaderFile="Sensordata.h", GetFunction="GYR_getGyrSfZmdegs", SetFunction="set_$N", DataType="int32")
COCA_os = Simulink.Signal(StorageClass="GetSet", GetFunction="COCA_getOs", SetFunction="set_$N", DataType="int16")
COBI_hubSetup = Simulink.Signal(StorageClass="GetSet", HeaderFile="Sensordata.h", GetFunction="COBI_getHubSetup", SetFunction="set_$N", DataType="int16")
SPECO_getPresentSpeed = Simulink.Signal(StorageClass="GetSet", HeaderFile="SpeedCoordinator.h", GetFunction="SPECO_getPresentSpeed", SetFunction="SPECO_setPresentSpeedNONE", DataType="typ_speed_10m_h_t")
typ_speed_10m_h_t = Simulink.NumericType(DataTypeMode="Fixed-point: slope and bias scaling", SignednessBool=false, WordLength=16, FixedExponent=-7, SlopeAdjustmentFactor=1.28, HeaderFile="Commons.h")
SensorDataErrorState = Simulink.Signal(StorageClass="Struct", StructName="SDM_out", DataType="uint16", InitialValue="0")
Sig = Simulink.Signal()
maxAccVarNoMotion_mg = Simulink.Parameter(250, StorageClass="Struct", StructName="SDM_par", DataType="uint16")
maxDeviationGravityCheck_mg = Simulink.Parameter(300, StorageClass="Struct", StructName="SDM_par", DataType="uint16")
maxAccDiffSum_mg = Simulink.Parameter(0, StorageClass="Struct", StructName="SDM_par", DataType="uint16")
maxGyrDiffSum_mdegs = Simulink.Parameter(0, StorageClass="Struct", StructName="SDM_par", DataType="uint16")
maxGyrVarNoMotion_mdegs = Simulink.Parameter(5000, StorageClass="Struct", StructName="SDM_par", DataType="uint16")
maxAccVarNoMotionShortTerm_mg = Simulink.Parameter(5, StorageClass="Struct", StructName="SDM_par", DataType="uint16")
maxGyrVarNoMotionShortTerm_mdegs = Simulink.Parameter(200, StorageClass="Struct", StructName="SDM_par", DataType="uint16")
maxMeanRotationRate_mdegs = Simulink.Parameter(25000, StorageClass="Struct", StructName="SDM_par", DataType="uint32")
maxGyrVarNoMotionSingleAxis_mdegs = Simulink.Parameter(50, StorageClass="Struct", StructName="SDM_par", DataType="uint32")
CRCL_CobiHubConnection = Simulink.Signal(StorageClass="GetSet", HeaderFile="RotateImuData.h", GetFunction="CRCL_getCobiHubConnection", SetFunction="CRCL_setCobiHubConnection", DataType="int16")
CRCL_sdoFire = Simulink.Signal(StorageClass="GetSet", HeaderFile="RotateImuData.h", GetFunction="CRCL_getSdoFire", SetFunction="CRCL_setSdoFire", DataType="uint8")